# Grasshopper definition framer 1.gh (Grasshopper 0.9.76)
# plug-ins: Kangaroo Components, PlanktonGh

crv = Curve([<curve referenced from the Rhino model> x3])
# C:\Program Files (x86)\Computers and Structures\SAP2000 18\CSi_OAPI_Documentation.chm
getsap18 = VBScript(run=Button(), Reference="C:\Program Files (x86)\Computers and Structures\SAP2000 18\SAP2000v18.dll")  # -> out, SapModel
# ---------- getsap18: VB ----------
    If run Then

      ' - attach to running SAP - - - - - - - - - - - - - - - - - - - - - - - - -
      'BV_Model10_R8.sdb

      Dim mySapObject As cOAPI
      mySapObject = Nothing

      'attach to a running instance of Sap2000
      'get the active Sap2000 object
      mySapObject = GetObject(, "CSI.SAP2000.API.SapObject")
      AppActivate("SAP2000")

      'Get a reference to cSapModel to access all OAPI classes and functions
      'Dim mySapModel As cSapModel
      mySapModel = mySapObject.SapModel

    End If


    SapModel_ = mySapModel
# ---------- getsap18: VB additional code ----------
  Private Shared mySapModel As cSapModel
# ---------- end getsap18 ----------
loft = Loft(Curves=crv, Options={Adjust=False, Closed=False, LoftEnds=0, LoftSimp=0, LoftType=0, Rebuild=10, Refit=0.01})
meshmachine = MeshMachine(
    Geometry=loft,
    Length=Slider(9.11, range=1..100),
    Flip=1,
    PullStrength=0.8,
    CurvatureAdaptivity=Slider(1, range=0..1),
    BoundaryScale=1,
    BoundaryDistance=5,
    Exponent=2,
    Background=0.5,
    Iterations=1,
    Reset=Toggle(True))
pmesh = PlanktonMesh(meshmachine)
mesh = Mesh(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)
getareas = VBScript(
    SapModel=getsap18.SapModel,
    run=Button(),
    Reference="C:\Program Files (x86)\Computers and Structures\SAP2000 18\SAP2000v18.dll")  # -> out, PtNames, AreaNames
# ---------- getareas: VB ----------
    Dim mySapModel As csapmodel
    mySapModel = CType(_SapModel, cSapModel)
    Dim ret As Long

    If run Then
      PtNames.clear
      AreaNames.clear

      Dim namecount As Double
      Dim AreaNamesArr() As String : AreaNamesArr = Nothing
      ret = mySapModel.AreaObj.GetNameList(NameCount, AreaNamesArr)
      AreaNames.addrange(AreaNamesArr.ToList)

      For i As Integer = 0 To ubound(AreaNamesArr)

        Dim PtCount As Long
        Dim PtNamesArr() As String : PtNamesArr = nothing
        ret = mySapModel.AreaObj.GetPoints(AreaNamesArr(i), PtCount, PtNamesArr)

        PtNames.addrange(PtNamesArr.ToList, New GH_Path(i))

      Next


    End If

    PtNames_ = PtNames
    AreaNames_ = AreaNames
# ---------- getareas: VB additional code ----------
  Private Shared PtNames As New datatree(Of String)
  Private Shared AreaNames As New list(Of String)
# ---------- end getareas ----------
medges = MeshEdges(Mesh=mesh)  # -> NakedEdges, InteriorEdges, NonManifoldEdges
demesh = DeconstructMesh(Mesh=mesh)  # -> Vertices, Faces, Colours, Normals
deface = DeconstructFace(Face=demesh.Faces)  # -> CornerA, CornerB, CornerC, CornerD
movepts18 = VBScript(run=Button(), Reference="C:\Program Files (x86)\Computers and Structures\SAP2000 18\SAP2000v18.dll")  # -> out, Pts, PtNames; inputs PtNames: list, NewPts: list of Point3d
# ---------- movepts18: VB ----------
    Dim mySapModel As csapmodel
    mySapModel = CType(_SapModel, cSapModel)
    Dim ret As Long

    ' - - - - - - - - - - - - - - - - - - - - - + - - - + - - - + - - - + - - - +
    If run

      For i As Integer = 0 To _PtNames.count() - 1

        ret = mySapModel.EditPoint.ChangeCoordinates(_PtNames(i), _NewPts(i).X, _NewPts(i).Y, _NewPts(i).Z)

      Next

      print(ret)
    End If
# ---------- end movepts18 ----------
addpts = VBScript(
    SapModel=getsap18.SapModel,
    Pts=demesh.Vertices,
    run=Button(),
    Reference="C:\Program Files (x86)\Computers and Structures\SAP2000 18\SAP2000v18.dll")  # -> out, PtNames; inputs Pts: list of Point3d
# ---------- addpts: VB ----------
    Dim mySapModel As csapmodel
    mySapModel = CType(_SapModel, cSapModel)
    Dim ret As Long

    If run Then
      PtNames.clear
      ret = Nothing

      'Dim namecount As Double
      'Dim AreaNamesArr() As String : AreaNamesArr = Nothing
      'ret = mySapModel.AreaObj.GetNameList(NameCount, AreaNamesArr)

      For i As Integer = 0 To _pts.count() - 1

        Dim ptname As String = nothing
        'Dim PtCount As Long
        'Dim PtNamesArr() As String : PtNamesArr = nothing
        'ret = mySapModel.AreaObj.GetPoints(AreaNamesArr(i), PtCount, PtNamesArr)

        'PtNames.addrange(PtNamesArr.ToList, New GH_Path(i))

        mySapModel.PointObj.AddCartesian(_pts(i).X, _pts(i).Y, _pts(i).Z, ptname)
        PtNames.add(ptname)

      Next


    End If

    PtNames_ = PtNames
# ---------- addpts: VB additional code ----------
  Private Shared PtNames As New List(Of String)
# ---------- end addpts ----------
item = ListItem(List=addpts.PtNames, Index=deface.CornerA, Wrap=True)
item_2 = ListItem(List=addpts.PtNames, Index=deface.CornerB, Wrap=True)
item_3 = ListItem(List=addpts.PtNames, Index=deface.CornerC, Wrap=True)
item_4 = ListItem(List=addpts.PtNames, Index=deface.CornerD, Wrap=True)
path_mapper = PathMapper(item, source="{A;B}", target="{A;0}")
path_mapper_2 = PathMapper(item_2, source="{A;B}", target="{A;1}")
path_mapper_3 = PathMapper(item_3, source="{A;B}", target="{A;2}")
path_mapper_4 = PathMapper(item_4, source="{A;B}", target="{A;3}")
rec = DataRecorder(movepts18.out, DataLimit=-10, RecordData=True)
txt = Text([path_mapper, path_mapper_2, path_mapper_3, path_mapper_4])
flip = FlipMatrix(Data=txt)  # -> simplify(Data)
getframes = VBScript(run=Button(), Reference="C:\Program Files (x86)\Computers and Structures\SAP2000 18\SAP2000v18.dll")  # -> out, FrameLines, FrameNames, JointNamesJ, JointNamesL, Sections
# ---------- getframes: VB ----------
    Dim mySapModel As csapmodel
    mySapModel = CType(_SapModel, cSapModel)


    If run Then

      FrameNames = Nothing
      FrameLines.Clear
      JointNames_J.clear
      JointNames_L.Clear
      Sections.Clear

      ' - Query model - - - - - - - - - - - - - - - - - - - - + - - - + - - - + - - - + - - - +
      Dim ret As Long

      Dim FrameCount As Int32

      ret = mySapModel.FrameObj.GetNameList(FrameCount, FrameNames)

      For i As Integer = 0 To FrameCount - 1
        Dim pt1 As String : pt1 = Nothing
        dim pt2 as string : pt2 = nothing
        Dim x1, y1, z1, x2, y2, z2 As Double
        Dim propname As String : PropName = Nothing
        Dim SAuto  As String : SAuto = Nothing
        ret = mySapModel.FrameObj.GetPoints(FrameNames(i), pt1, pt2)
        JointNames_J.add(pt1)
        JointNames_L.add(pt2)
        ret = mySapModel.PointObj.GetCoordCartesian(pt1, x1, y1, z1)
        ret = mySapModel.PointObj.GetCoordCartesian(pt2, x2, y2, z2)
        FrameLines.add(New line(x1, y1, z1, x2, y2, z2))
        ret = mySapModel.FrameObj.GetSection(FrameNames(i), PropName, SAuto)
        Sections.add(PropName)
      Next

      'Get forces + visualize!!



    End If

    FrameLines_ = FrameLines
    FrameNames_ = FrameNames
    JointNamesJ_ = JointNames_J
    JointNamesL_ = JointNames_L
    Sections_ = Sections
# ---------- getframes: VB additional code ----------
  Private Shared FrameNames() As String
  Private Shared FrameLines As New list(Of Line)
  Private Shared JointNames_J As New list(Of String)
  Private Shared JointNames_L As New list(Of String)
  Private Shared Sections As New list(Of String)
# ---------- end getframes ----------
addareas = VBScript(
    SapModel=getsap18.SapModel,
    Faces=flip,
    run=Button(),
    Reference="C:\Program Files (x86)\Computers and Structures\SAP2000 18\SAP2000v18.dll")  # -> out, AreaNames; inputs Faces: tree
# ---------- addareas: VB ----------
    Dim mySapModel As csapmodel
    mySapModel = CType(_SapModel, cSapModel)
    Dim ret As Long

    If run Then
      AreaNames.clear
      ret = Nothing

      For i As Integer = 0 To _Faces.BranchCount() - 1

        Dim areaname As String = Nothing
        mySapModel.AreaObj.AddByPoint(4, _Faces.Branch(i).ToArray(), areaname)
        AreaNames.add(areaname)

      Next


    End If

    AreaNames_ = AreaNames
# ---------- addareas: VB additional code ----------
  Private Shared AreaNames As New List(Of String)
# ---------- end addareas ----------
getforces = VBScript(LoadCase="SDL", run=Button(), Reference="C:\Program Files (x86)\Computers and Structures\SAP2000 17\SAP2000v17.dll")  # -> out, V, M; inputs FrameNames: list
# ---------- getforces: VB ----------
    Dim mySapModel As csapmodel
    mySapModel = CType(_SapModel, cSapModel)
    Dim ret As Long

    If run Then

      V.Clear
      M.clear

      Dim PList As New list(Of Double)
      Dim V2List As New list(Of Double)
      Dim V3List As New list(Of Double)
      Dim TList As New list(Of Double)
      Dim M2List As New list(Of Double)
      Dim M3List As New list(Of Double)


      Dim NumberResults As Long
      Dim ObjSta(), ElmSta() as double
      Dim Obj(),  Elm(),  LoadCase(), StepType()  As String
      obj = Nothing
      ObjSta = Nothing
      Elm = Nothing
      ElmSta = Nothing
      loadcase = Nothing
      steptype = Nothing
      Dim StepNum(), P(), V2(), V3(), T(), M2(), M3() As Double
      StepNum = Nothing
      P = Nothing
      V2 = Nothing
      V3 = Nothing
      T = Nothing
      M2 = Nothing
      M3 = Nothing

      ret = mySapModel.Results.Setup.SetCaseSelectedForOutput(_LoadCase)
      For i As Integer = 0 To _FrameNames.count() - 1
        ret = mySapModel.Results.FrameForce(_FrameNames(i), eItemTypeElm.ObjectElm, NumberResults, Obj, ObjSta, Elm, ElmSta, LoadCase, StepType, StepNum, P, V2, V3, T, M2, M3)
        print(NumberResults.tostring)
        Plist.add(P(0))
        V2List.add(V2(0))
        V3List.add(V3(0))
        Tlist.add(T(0))
        M2List.add(M2(0))
        M3List.add(M3(0))
      Next

      V.AddRange(Plist, New GH_Path(0))
      V.AddRange(V2list, New GH_Path(1))
      V.AddRange(V3list, New GH_Path(2))
      M.AddRange(Tlist, New GH_Path(0))
      M.AddRange(M2list, New GH_Path(1))
      M.AddRange(M3list, New GH_Path(2))

    End If
    V_ = V
    M_ = M
# ---------- getforces: VB additional code ----------
  Private Shared V As New DataTree(Of Double)
  Private Shared M As New DataTree(Of Double)
# ---------- end getforces ----------
